# Grasshopper definition SpaceTypes.gh (Grasshopper 1.0.7)
# plug-ins: SAM

path = FilePath("G:\My Drive\SAM\NCMmodel.json")
fromfile = FromFile(_path=path, _run=True, SAM_ComponentVersion="1.0.0")  # -> SAMObjects, Successful
inspect = Inspect(_object=fromfile.SAMObjects, SAM_ComponentVersion="1.0.0")  # -> Shells, Spaces
samanalytical_panelgroup = SAMAnalyticalPanelGroup(PanelGroup=3, SAM_ComponentVersion="1.0.0")
samanalytical_adjacentspaces = SAMAnalyticalAdjacentSpaces(
    _analytical=fromfile.SAMObjects,
    _space=inspect.Spaces,
    _panelGroups_=samanalytical_panelgroup,
    SAM_ComponentVersion="1.0.1")  # -> Spaces, Panels, SpacesWithDoors, PanelsWithDoors, SpacesWithWindows, PanelsWithWindows
samgeometry_sectionbyshell = SAMGeometrySectionByShell(_shell=flatten(inspect.Shells), SAM_ComponentVersion="1.0.0")
inspect_2 = Inspect(_object=inspect.Spaces, SAM_ComponentVersion="1.0.0")  # -> Area, InternalCondition, Name, Volume
inspect_3 = Inspect(_object=samanalytical_adjacentspaces.SpacesWithDoors, SAM_ComponentVersion="1.0.0")
inspect_4 = Inspect(_object=samanalytical_adjacentspaces.PanelsWithDoors, SAM_ComponentVersion="1.0.0")
inspect_5 = Inspect(_object=samanalytical_adjacentspaces.Spaces, SAM_ComponentVersion="1.0.0")
inspect_6 = Inspect(_object=samanalytical_adjacentspaces.Panels, SAM_ComponentVersion="1.0.0")
samgeometry_thinnessratio = SAMGeometryThinnessRatio(_face3D=flatten(samgeometry_sectionbyshell), SAM_ComponentVersion="1.0.0")
c_script = CSharpScript(x=inspect_5, y=inspect_6)  # -> flatten(A), flatten(B), flatten(C), flatten(D); inputs x: list of String, y: list of Double
# ---------- c_script: C# ----------
    List<Tuple<string, double>> tuples = new List<Tuple<string, double>>();

    A = "unidentified";
    B = "unidentified";
    C = "unidentified";
    D = "unidentified";

    for(int i = 0; i < x.Count; i++)
    {
      string name = x[i];
      double area = 0;

      if(y.Count < i)
      {
        area = y[i];
      }
      else
      {
        area = y[y.Count - 1];
      }

      int index = tuples.FindIndex(a => a.Item1 == name);
      if(index == -1)
      {
        tuples.Add(new Tuple<string, double>(name, area));
      }
      else
      {
        tuples[index] = new Tuple<string, double>(name, tuples[index].Item2 + area);
      }
    }

    tuples.Sort((a, b) => a.Item2.CompareTo(b.Item2));

    if(tuples.Count > 0)
    {
      A = tuples[0].Item1;

      if(tuples.Count > 1)
      {
        B = tuples[1].Item1;

        if(tuples.Count > 2)
        {
          C = tuples[2].Item1;

          if(tuples.Count > 3)
          {
            D = tuples[3].Item1;
          }
        }
      }
    }
# ---------- end c_script ----------
c_script_2 = CSharpScript(x=inspect_3, y=inspect_4)  # -> flatten(A), flatten(B), flatten(C), flatten(D); inputs x: list of String, y: list of Double; same code as c_script
inspect_7 = Inspect(_object=inspect_2.InternalCondition, SAM_ComponentVersion="1.0.0")
path_2 = FilePath("C:\Users\jakub\GitHub\HoareLea\SAM_MachineLearning\files\resources\Analytical\MachineLearning\Data\SpaceTypes.txt")
c_script_3 = CSharpScript(
    path=path_2,
    names=inspect_2.Name,
    volumes=inspect_2.Volume,
    areas=inspect_2.Area,
    thinnessRatios=samgeometry_thinnessratio,
    adjacentSpace1=c_script.A,
    adjacentSpace2=c_script.B,
    adjacentSpace3=c_script.C,
    adjacentSpace4=c_script.D,
    adjacentDoor1=c_script_2.A,
    adjacentDoor2=c_script_2.B,
    adjacentDoor3=c_script_2.C,
    adjacentDoor4=c_script_2.D,
    types=inspect_7)  # -> successful, text; inputs path: String, names: list of String, volumes: list of Double, areas: list of Double, thinnessRatios: list of Double, adjacentSpace1: list of String, adjacentSpace2: list of String, adjacentSpace3: list of String, adjacentSpace4: list of String, adjacentDoor1: list of String, adjacentDoor2: list of String, adjacentDoor3: list of String, adjacentDoor4: list of String, types: list of String
# ---------- c_script_3: C# ----------
    successful = false;

    List <string> header = new List<string>() {
        "name",
        "volume",
        "area",
        "thinnessRatio",
        "adjacentSpace1",
        "adjacentSpace2",
        "adjacentSpace3",
        "adjacentSpace4",
        "adjacentDoor1",
        "adjacentDoor2",
        "adjacentDoor3",
        "adjacentDoor4",
        "type"};

    List < string > lines = new List<string>() {string.Join("\t", header)};

    for(int i = 0; i < names.Count; i++)
    {
      string name = Simplify(names[i]);
      double volume = Math.Round(volumes[i], 2);
      double area = Math.Round(areas[i], 2);
      double thinnessRatio = Math.Round(thinnessRatios[i], 3);

      List<string> values = null;

      values = new List<string>();
      values.Add(name);
      values.Add(volume.ToString());
      values.Add(area.ToString());
      values.Add(thinnessRatio.ToString());
      values.Add(Simplify(adjacentSpace1[i]));
      values.Add(Simplify(adjacentSpace2[i]));
      values.Add(Simplify(adjacentSpace3[i]));
      values.Add(Simplify(adjacentSpace4[i]));
      values.Add(Simplify(adjacentDoor1[i]));
      values.Add(Simplify(adjacentDoor2[i]));
      values.Add(Simplify(adjacentDoor3[i]));
      values.Add(Simplify(adjacentDoor4[i]));
      values.Add(types[i]);

      lines.Add(string.Join("\t", values));

      values = new List<string>();
      values.Add(name);
      values.Add((0.0F).ToString());
      values.Add((0.0F).ToString());
      values.Add((0.0F).ToString());
      values.Add(Simplify("unidentified"));
      values.Add(Simplify("unidentified"));
      values.Add(Simplify("unidentified"));
      values.Add(Simplify("unidentified"));
      values.Add(Simplify("unidentified"));
      values.Add(Simplify("unidentified"));
      values.Add(Simplify("unidentified"));
      values.Add(Simplify("unidentified"));
      values.Add(types[i]);

      lines.Add(string.Join("\t", values));


      successful = true;
    }

    text = lines;

    System.IO.File.WriteAllLines(path, lines);
# ---------- c_script_3: C# additional code ----------
  private string Simplify(string text)
  {
    if(text == null)
    {
      return string.Empty;
    }

    string result = text.Trim().ToLower();

    result = result.Replace("-", " ");
    result = result.Replace("_", " ");

    string[] values = result.Split(new string[] {" "}, StringSplitOptions.RemoveEmptyEntries);

    List<string> tokens = new List<string>();
    foreach(string value in values)
    {
      if(value.Length < 2)
      {
        continue;
      }

      bool hasDigit = false;
      foreach(char symbol in value)
      {
        if(char.IsDigit(symbol))
        {
          hasDigit = true;
          break;
        }
      }

      if(hasDigit)
      {
        continue;
      }

      tokens.Add(value);
    }

    return string.Join(" ", tokens);
  }
# ---------- end c_script_3 ----------
